# Dynamo graph AfficheLeCentreDeGraviteBlog.dyn (Dynamo 0.8.0.950)

# note: Dessine la famille dans Revit
family_types = FamilyTypes("CdG:CdG")
# note: Cliquer sur le bouton "Change" puis selectionner l'objet dans Revit
select_model_element = DSModelElementSelection()  # 1 picked in the model
# note: Dessine l'objet dans l'intface
geometry = Element.Geometry(select_model_element)
# note: Calcule le centre de gravité de l'objet
centroid = Solid.Centroid(geometry, lacing=CrossProduct)
byPoint = FamilyInstance.ByPoint(family_types, centroid)
# note: Champ recherché
string = StringInput("Centre de Gravite")
# note: Séparateur
string_2 = StringInput("; ")
# note: Extrait la coordonnée X, Y et Z
X = Point.X(centroid)
# note: Transforme de Num en String
string_from_object = FromObject(X)
number = DoubleInput(0)
number_2 = DoubleInput(6)
# note: Ne garde que le x lettres
substring = String.Substring(str=string_from_object, startIndex=number, length=number_2)
extrait_le_y = Vector.Y(centroid)
string_from_object_2 = FromObject(extrait_le_y)
substring_2 = String.Substring(str=string_from_object_2, startIndex=number, length=number_2)
extrait_le_z = Vector.Z(centroid)
string_from_object_3 = FromObject(extrait_le_z)
substring_3 = String.Substring(str=string_from_object_3, startIndex=number, length=number_2)
# note: Concatène les caine de caractères
concat = String.Concat(substring, substring_2, substring_3)
# note: Coordonnées CdG concaténé avec séparateur
join = String.Join(string_2, concat)
# note: On remplie la famille de la valeur du centre de gravité
setParameterByName = Element.SetParameterByName(element=family_types, parameterName=string, value=join)
